# Grasshopper definition martini.gh (Grasshopper 1.0.7)
# plug-ins: Martini Info

path = FilePath("/Users/alasdairmott/Desktop/fuji.png")
martini = Martini(Path=path, Error=Slider(100, range=0..1000))
mesh = Mesh(martini)
scale_nu = ScaleNU(Geometry=mesh, Plane=PlaneXY(0, 0, 0), ScaleX=1, ScaleY=1, ScaleZ=Slider(0.029, range=0..0.1))  # -> Geometry, Transform
medges = MeshEdges(Mesh=scale_nu.Geometry)  # -> NakedEdges, InteriorEdges, NonManifoldEdges
